# Grasshopper definition A2.gh (Grasshopper 1.0.7)

# Change width and height of the intersection slots
number_slider = Slider(5, range=0..100)
# Change the radius of the kit
number_slider_2 = Slider(10, range=0..100)
# Change the number of intersection slots
number_slider_3 = Slider(25, range=0..100)
# Change the thickness of the kit based on cardboard
number_slider_4 = Slider(6, range=0..100)
point = Point(Point(0, 0, 0))
subtraction = Subtraction(A=Slider(0, range=0..100), B=Slider(2, range=0..100))
division = Division(A=number_slider, B=subtraction)
subtraction_2 = Subtraction(A=number_slider_3, B=number_slider_2)
vector_xyz = VectorXYZ(XComponent=division, YComponent=subtraction_2, ZComponent=0)  # -> Vector, Length
rectangle = Rectangle(Plane=point, XSize=number_slider, YSize=number_slider_2, Radius=0)  # -> Rectangle, Length
circle = Circle(Plane=point, Radius=number_slider_3)
move = Move(Geometry=rectangle.Rectangle, Motion=vector_xyz.Vector)  # -> Geometry, Transform
polar_array = PolarArray(Geometry=move.Geometry, Plane=point, Count=number_slider_4, Angle=6.283185307)  # -> Geometry, Transform
intersecting_slots = Curve(polar_array.Geometry)
circle_2 = Curve(circle)
flatten_tree = FlattenTree(Tree=intersecting_slots, Path="{0}")
flatten_tree_2 = FlattenTree(Tree=circle_2, Path="{0}")
trim_with_regions = TrimWithRegions(Curve=flatten_tree_2, Regions=flatten_tree)  # -> Inside, Outside
trim_with_region = TrimWithRegion(Curve=flatten_tree, Region=flatten_tree_2)  # -> Inside, Outside
curve = Curve(flatten(trim_with_regions.Outside))
curve_2 = Curve(flatten(trim_with_region.Inside))
join_curves = JoinCurves(Curves=[curve, curve_2], Preserve=False)
unit_z = UnitZ(Factor=Slider(4, range=0..100))
curve_3 = Curve(join_curves)
panel = Panel("Bake this")
extrude = Extrude(Base=join_curves, Direction=unit_z)
